# Dynamo graph Answer.dyn (Dynamo 2.10.1.3976)

# group: 1
file_path = Filename(".\Output1.xlsx")
string = StringInput("Sheet1")
number = DoubleInput(0)
categories = Categories("OST_Walls")
all_elements_of_category = ElementsOfCategory(Category=categories)
id = Element.Id(element=all_elements_of_category)
string_2 = StringInput("Mark")
getParameterValueByName = Element.GetParameterValueByName(element=all_elements_of_category, parameterName=string_2)
list_create = List.Create(item0=id, item1=getParameterValueByName)
boolean = BoolSelector(true)
exportExcel = Data.ExportExcel(filePath=file_path, sheetName=string, startRow=number, startCol=number, data=list_create, overWrite=boolean)  # frozen

# group: 2
file_path_2 = Filename(".\Output1.xlsx")
string_3 = StringInput("Sheet1")
number_2 = DoubleInput(0)
categories_2 = Categories("OST_StructuralColumns")
all_elements_of_category_2 = ElementsOfCategory(Category=categories_2)
id_2 = Element.Id(element=all_elements_of_category_2)
string_4 = StringInput("Mark")
getParameterValueByName_2 = Element.GetParameterValueByName(element=all_elements_of_category_2, parameterName=string_4)
list_create_2 = List.Create(item0=id_2, item1=getParameterValueByName_2)
boolean_2 = BoolSelector(true)
exportExcel_2 = Data.ExportExcel(filePath=file_path_2, sheetName=string_3, startRow=number_2, startCol=number_2, data=list_create_2, overWrite=boolean_2)  # frozen

# group: 3
file_path_3 = Filename(".\Output1.xlsx")
string_5 = StringInput("Sheet1")
number_3 = DoubleInput(0)
categories_3 = Categories("OST_StructuralColumns")
all_elements_of_category_3 = ElementsOfCategory(Category=categories_3)
string_6 = StringInput("Volume")
getParameterValueByName_3 = Element.GetParameterValueByName(element=all_elements_of_category_3, parameterName=string_6)
number_4 = DoubleInput(2)
gt = getParameterValueByName_3 > number_4
filterByBoolMask = List.FilterByBoolMask(list=all_elements_of_category_3, mask=gt)
id_3 = Element.Id(element=filterByBoolMask.in)
string_7 = StringInput("Mark")
getParameterValueByName_4 = Element.GetParameterValueByName(element=filterByBoolMask.in, parameterName=string_7)
list_create_3 = List.Create(item0=id_3, item1=getParameterValueByName_4)
boolean_3 = BoolSelector(true)
exportExcel_3 = Data.ExportExcel(filePath=file_path_3, sheetName=string_5, startRow=number_3, startCol=number_3, data=list_create_3, overWrite=boolean_3)  # frozen

# group: 4
file_path_4 = Filename(".\Output1.xlsx")
string_8 = StringInput("Sheet1")
number_5 = DoubleInput(0)
categories_4 = Categories("OST_StructuralFraming")
all_elements_of_category_4 = ElementsOfCategory(Category=categories_4)
string_9 = StringInput("Reference Level")
getParameterValueByName_5 = Element.GetParameterValueByName(element=all_elements_of_category_4, parameterName=string_9)
string_10 = StringInput("Name")
getParameterValueByName_6 = Element.GetParameterValueByName(element=getParameterValueByName_5, parameterName=string_10)
string_11 = StringInput("Level 3")
eq = getParameterValueByName_6 == string_11
filterByBoolMask_2 = List.FilterByBoolMask(list=all_elements_of_category_4, mask=eq)
id_4 = Element.Id(element=filterByBoolMask_2.in)
string_12 = StringInput("Length")
getParameterValueByName_7 = Element.GetParameterValueByName(element=filterByBoolMask_2.in, parameterName=string_12)
string_13 = StringInput("Volume")
getParameterValueByName_8 = Element.GetParameterValueByName(element=filterByBoolMask_2.in, parameterName=string_13)
string_14 = StringInput("Elevation at Top")
getParameterValueByName_9 = Element.GetParameterValueByName(element=filterByBoolMask_2.in, parameterName=string_14)
string_15 = StringInput("Elevation at Bottom")
getParameterValueByName_10 = Element.GetParameterValueByName(element=filterByBoolMask_2.in, parameterName=string_15)
list_create_4 = List.Create(item0=id_4, item1=getParameterValueByName_7, item2=getParameterValueByName_8, item3=getParameterValueByName_9, item4=getParameterValueByName_10)
transpose = List.Transpose(lists=list_create_4)
boolean_4 = BoolSelector(true)
exportExcel_4 = Data.ExportExcel(filePath=file_path_4, sheetName=string_8, startRow=number_5, startCol=number_5, data=transpose, overWrite=boolean_4)  # frozen
parameters = Element.Parameters(element=getParameterValueByName_5)

# group: 5
file_path_5 = Filename(".\Output2.xlsx")
string_16 = StringInput("SF")
number_6 = DoubleInput(0)
categories_5 = Categories("OST_StructuralFoundation")
all_elements_of_category_5 = ElementsOfCategory(Category=categories_5)
id_5 = Element.Id(element=all_elements_of_category_5)
string_17 = StringInput("Mark")
getParameterValueByName_11 = Element.GetParameterValueByName(element=all_elements_of_category_5, parameterName=string_17)
list_create_5 = List.Create(item0=id_5, item1=getParameterValueByName_11)
boolean_5 = BoolSelector(true)
exportExcel_5 = Data.ExportExcel(filePath=file_path_5, sheetName=string_16, startRow=number_6, startCol=number_6, data=list_create_5, overWrite=boolean_5)  # frozen
