# Dynamo graph Answer.dyn (Dynamo 2.10.1.3976)

# group: 1
file_path = Filename(".\Structural Foundation.xlsx")
file_from_path = FileObject(path=file_path)
string = StringInput("Structural Foundation csv")
boolean = BoolSelector(false)
boolean_2 = BoolSelector(false)
importExcel = Data.ImportExcel(file=file_from_path, sheetName=string, readAsStrings=boolean, showExcel=boolean_2)
transpose = List.Transpose(lists=importExcel)
number = DoubleInput(0)
getItemAtIndex = List.GetItemAtIndex(list=transpose, index=number)
floor = Math.Floor(number=getItemAtIndex)
element_by_id = ElementById(Id=floor)
string_2 = StringInput("Comments")
number_2 = DoubleInput(1)
getItemAtIndex_2 = List.GetItemAtIndex(list=transpose, index=number_2)
setParameterByName = Element.SetParameterByName(element=element_by_id, parameterName=string_2, value=getItemAtIndex_2)  # frozen

# group: 2
file_path_2 = Filename(".\Structural Column.xlsx")
file_from_path_2 = FileObject(path=file_path_2)
string_3 = StringInput("Structural Column csv")
boolean_3 = BoolSelector(false)
boolean_4 = BoolSelector(false)
importExcel_2 = Data.ImportExcel(file=file_from_path_2, sheetName=string_3, readAsStrings=boolean_3, showExcel=boolean_4)
transpose_2 = List.Transpose(lists=importExcel_2)
number_3 = DoubleInput(0)
getItemAtIndex_3 = List.GetItemAtIndex(list=transpose_2, index=number_3)
floor_2 = Math.Floor(number=getItemAtIndex_3)
element_by_id_2 = ElementById(Id=floor_2)
string_4 = StringInput("Volume")
getParameterValueByName = Element.GetParameterValueByName(element=element_by_id_2, parameterName=string_4)
number_4 = DoubleInput(2)
gt = getParameterValueByName > number_4
filterByBoolMask = List.FilterByBoolMask(list=element_by_id_2, mask=gt)
string_5 = StringInput("Comments")
number_5 = DoubleInput(1)
getItemAtIndex_4 = List.GetItemAtIndex(list=transpose_2, index=number_5)
filterByBoolMask_2 = List.FilterByBoolMask(list=getItemAtIndex_4, mask=gt)
setParameterByName_2 = Element.SetParameterByName(element=filterByBoolMask.in, parameterName=string_5, value=filterByBoolMask_2.in)  # frozen

# group: 3
file_path_3 = Filename(".\Structural Framing.xlsx")
file_from_path_3 = FileObject(path=file_path_3)
string_6 = StringInput("Structural Framing csv")
boolean_5 = BoolSelector(false)
boolean_6 = BoolSelector(false)
importExcel_3 = Data.ImportExcel(file=file_from_path_3, sheetName=string_6, readAsStrings=boolean_5, showExcel=boolean_6)
transpose_3 = List.Transpose(lists=importExcel_3)
number_6 = DoubleInput(0)
getItemAtIndex_5 = List.GetItemAtIndex(list=transpose_3, index=number_6)
floor_3 = Math.Floor(number=getItemAtIndex_5)
element_by_id_3 = ElementById(Id=floor_3)
string_7 = StringInput("Start Level Offset")
number_7 = DoubleInput(1)
getItemAtIndex_6 = List.GetItemAtIndex(list=transpose_3, index=number_7)
setParameterByName_3 = Element.SetParameterByName(element=element_by_id_3, parameterName=string_7, value=getItemAtIndex_6)  # frozen
string_8 = StringInput("End Level Offset")
number_8 = DoubleInput(2)
getItemAtIndex_7 = List.GetItemAtIndex(list=transpose_3, index=number_8)
setParameterByName_4 = Element.SetParameterByName(element=element_by_id_3, parameterName=string_8, value=getItemAtIndex_7)  # frozen

# group: 4
file_path_4 = Filename(".\Wall.xlsx")
file_from_path_4 = FileObject(path=file_path_4)
string_9 = StringInput("Wall csv")
boolean_7 = BoolSelector(false)
boolean_8 = BoolSelector(false)
importExcel_4 = Data.ImportExcel(file=file_from_path_4, sheetName=string_9, readAsStrings=boolean_7, showExcel=boolean_8)
transpose_4 = List.Transpose(lists=importExcel_4)
number_9 = DoubleInput(0)
removeItemAtIndex = List.RemoveItemAtIndex(list=transpose_4, indices=number_9, lacing=CrossProduct)
number_10 = DoubleInput(0)
getItemAtIndex_8 = List.GetItemAtIndex(list=removeItemAtIndex, index=number_10)
floor_4 = Math.Floor(number=getItemAtIndex_8)
element_by_id_4 = ElementById(Id=floor_4)
string_10 = StringInput("Room Bounding")
number_11 = DoubleInput(1)
getItemAtIndex_9 = List.GetItemAtIndex(list=removeItemAtIndex, index=number_11)
setParameterByName_5 = Element.SetParameterByName(element=element_by_id_4, parameterName=string_10, value=getItemAtIndex_9)  # frozen
string_11 = StringInput("Precast")
number_12 = DoubleInput(2)
getItemAtIndex_10 = List.GetItemAtIndex(list=removeItemAtIndex, index=number_12)
setParameterByName_6 = Element.SetParameterByName(element=element_by_id_4, parameterName=string_11, value=getItemAtIndex_10)  # frozen
