# Dynamo graph Answer.dyn (Dynamo 2.10.1.3976)

# group: 1
family_types = FamilyTypes("Tree:Tree")
file_path = Filename("C:\Users\hokhs\Desktop\20220624 Dynamo Training for Digital Transformation\3. Model BIM Object by Dynamo\Tree.xlsx")
file_from_path = FileObject(path=file_path)
string = StringInput("Sheet1")
boolean = BoolSelector(false)
boolean_2 = BoolSelector(false)
importExcel = Data.ImportExcel(file=file_from_path, sheetName=string, readAsStrings=boolean, showExcel=boolean_2)
transpose = List.Transpose(lists=importExcel)
number = DoubleInput(0)
removeItemAtIndex = List.RemoveItemAtIndex(list=transpose, indices=number, lacing=CrossProduct)
number_2 = DoubleInput(0)
getItemAtIndex = List.GetItemAtIndex(list=removeItemAtIndex, index=number_2)
number_3 = DoubleInput(1)
getItemAtIndex_2 = List.GetItemAtIndex(list=removeItemAtIndex, index=number_3)
number_4 = DoubleInput(2)
getItemAtIndex_3 = List.GetItemAtIndex(list=removeItemAtIndex, index=number_4)
byCoordinates = Point.ByCoordinates(x=getItemAtIndex, y=getItemAtIndex_2, z=getItemAtIndex_3)
byPoint = FamilyInstance.ByPoint(familyType=family_types, point=byCoordinates)  # frozen
string_2 = StringInput("Overall Height")
number_5 = DoubleInput(5)
getItemAtIndex_4 = List.GetItemAtIndex(list=removeItemAtIndex, index=number_5)
setParameterByName = Element.SetParameterByName(element=byPoint, parameterName=string_2, value=getItemAtIndex_4)  # frozen
string_3 = StringInput("Diameter at Breast Height")
number_6 = DoubleInput(4)
getItemAtIndex_5 = List.GetItemAtIndex(list=removeItemAtIndex, index=number_6)
setParameterByName_2 = Element.SetParameterByName(element=byPoint, parameterName=string_3, value=getItemAtIndex_5)  # frozen
string_4 = StringInput("Crown Spread")
number_7 = DoubleInput(3)
getItemAtIndex_6 = List.GetItemAtIndex(list=removeItemAtIndex, index=number_7)
setParameterByName_3 = Element.SetParameterByName(element=byPoint, parameterName=string_4, value=getItemAtIndex_6)  # frozen

# group: 2
family_types_2 = FamilyTypes("20_SON-SCS-CSH-___-___:Nail Head_600x600")
file_path_2 = Filename(".\Soil Nail.xlsx")
file_from_path_2 = FileObject(path=file_path_2)
string_5 = StringInput("Sheet1")
boolean_3 = BoolSelector(false)
boolean_4 = BoolSelector(false)
importExcel_2 = Data.ImportExcel(file=file_from_path_2, sheetName=string_5, readAsStrings=boolean_3, showExcel=boolean_4)
transpose_2 = List.Transpose(lists=importExcel_2)
number_8 = DoubleInput(0)
removeItemAtIndex_2 = List.RemoveItemAtIndex(list=transpose_2, indices=number_8, lacing=CrossProduct)
number_9 = DoubleInput(0)
getItemAtIndex_7 = List.GetItemAtIndex(list=removeItemAtIndex_2, index=number_9)
number_10 = DoubleInput(1)
getItemAtIndex_8 = List.GetItemAtIndex(list=removeItemAtIndex_2, index=number_10)
number_11 = DoubleInput(2)
getItemAtIndex_9 = List.GetItemAtIndex(list=removeItemAtIndex_2, index=number_11)
byCoordinates_2 = Point.ByCoordinates(x=getItemAtIndex_7, y=getItemAtIndex_8, z=getItemAtIndex_9)
byPoint_2 = FamilyInstance.ByPoint(familyType=family_types_2, point=byCoordinates_2)
number_12 = DoubleInput(3)
getItemAtIndex_10 = List.GetItemAtIndex(list=removeItemAtIndex_2, index=number_12)
setRotation = FamilyInstance.SetRotation(familyInstance=byPoint_2, degree=getItemAtIndex_10)
